# Grasshopper definition Line-Topology.gh (Grasshopper 0.9.56)
# plug-ins: Sandbox

line = Line([Line((196.4149286, -236.0513623, 0), (249.2949603, 44.10912772, 0)), Line((249.2949603, 44.10912772, 0), (142.3157124, 128.6884568, 0)), Line((142.3157124, 128.6884568, 0), (110.557747, 112.1528378, 0)), Line((110.557747, 112.1528378, 0), (78.19701287, 46.10594781, 0)), Line((78.19701287, 46.10594781, 0), (142.5102593, -228.4365666, 0)), Line((613.7365464, 529.0708899, 0), (567.0201741, 276.041333, 0))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])
point = Slider(26, range=0..47)
line_topo = LineTopology(ListOfLines=line, Tolerance=0.001)  # -> ListOfPoints, LinePointStructure, PointPointStructure, PointLineStructure
eval = EvaluateLength(Curve=line, Length=0.5, Normalized=True)  # -> Point, Tangent, Parameter
branch = TreeBranch(Tree=line_topo.PointPointStructure, Path=point, MaintainPaths=True)
branch_2 = TreeBranch(Tree=line_topo.PointLineStructure, Path=point, MaintainPaths=True)
lp = Panel(line_topo.LinePointStructure)
points = PointList(Points=eval.Point, Tags=True, Lines=False, Size=10)
points_2 = PointList(Points=line_topo.ListOfPoints, Tags=True, Lines=False, Size=15)
item = ListItem(List=line_topo.ListOfPoints, Index=branch, Wrap=True)
sph = Sphere(Base=item, Radius=20)
pipe = Pipe(Curve=branch_2, Radius=5, Caps=0)
