# Grasshopper definition TopologyBrepEdge.gh (Grasshopper 1.0.7)
# plug-ins: Sandbox Topology

# "List faces that share a given edge."
# © 2025 by Tobias Schwinn
brep = Brep(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)
brep_2 = Brep(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)
merge = Merge(Data1=brep, Data2=brep_2)
brep_3 = Brep(merge)
edge = Slider(12, range=0..47)
debrep = DeconstructBrep(Brep=brep_3)  # -> simplify(Faces), Edges, Vertices
brep_topo_edge = BrepTopologyEdge(Breps=brep_3)  # -> ListOfEdgeCurves, FaceEdgeStructure, EdgeFaceStructure
pcen = PolygonCenter(Polyline=debrep.Faces)  # -> CenterV, CenterE, CenterA
eval = EvaluateLength(Curve=brep_topo_edge.ListOfEdgeCurves, Length=0.5, Normalized=True)  # -> Point, Tangent, Parameter
format = Format(Format="{{*;{0}}}", Culture=127, Data0=edge)
split = SplitTree(Data=brep_topo_edge.EdgeFaceStructure, Masks=flatten(format))  # -> Positive, Negative
points = PointList(Points=pcen.CenterV, Tags=True, Lines=False, Size=20)
points_2 = PointList(Points=eval.Point, Tags=True, Lines=False, Size=15)
ef = Panel(split.Positive)

# ---- group: Faces adjacent to given edge
item = ListItem(List=debrep.Faces, Index=split.Positive, Wrap=True)

# ----
item_2 = ListItem(List=brep_topo_edge.ListOfEdgeCurves, Index=edge, Wrap=True)

# ---- group: Faces that do NOT share a given edge
cull_i = CullIndex(List=debrep.Faces, Indices=split.Positive, Wrap=True)

# ----
pipe = Pipe(Curve=item_2, Radius=10, Caps=0)
preview = CustomPreview(Geometry=item, Material=ColourSwatch(SwatchColor=RGBA(147, 242, 92, 172)))
