# Grasshopper definition TopologyBrepVertexFilter.gh (Grasshopper 1.0.7)
# plug-ins: Sandbox Topology

# © 2025 by Tobias Schwinn
brep = Brep(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)
# "Select every vertex that has N face neighbors."
brep_2 = Brep(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)
merge = Merge(Data1=brep, Data2=brep_2)
brep_3 = Brep(merge)
valency = Slider(2, range=1..6)

brep_topo_vertex = BrepTopologyVertex(Brep=brep_3)  # -> ListOfVertices, FaceVertexStructure, VertexFaceStructure
brep_topo_vertex_filter = BrepTopologyVertexFilter(
    VertexList=brep_topo_vertex.ListOfVertices,
    VertexFaceStructure=brep_topo_vertex.VertexFaceStructure,
    ValencyFilter=valency)  # -> ListOfVertexIDs, ListOfVertices

debrep = DeconstructBrep(Brep=brep_3)  # -> Faces, Edges, Vertices
pcen = PolygonCenter(Polyline=debrep.Faces)  # -> CenterV, CenterE, CenterA
crv = Curve(debrep.Edges)
sph = Sphere(Base=brep_topo_vertex_filter.ListOfVertices, Radius=15)
points = PointList(Points=pcen.CenterV, Tags=True, Lines=False, Size=20)
points_2 = PointList(Points=brep_topo_vertex.ListOfVertices, Tags=True, Lines=False, Size=15)
I = Panel(brep_topo_vertex_filter.ListOfVertexIDs)
