# Grasshopper definition TopologyMeshEdge.gh (Grasshopper 1.0.7)
# plug-ins: MeshEdit Components, Weaverbird, Sandbox Topology

mesh = Mesh(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)
# "List faces that share a given edge."
# "List faces that are adjacent to a given face."
# © 2025 by Tobias Schwinn
mesh_2 = Mesh(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)
merge = Merge(Data1=mesh_2, Data2=mesh)  # -> graft(Result)
mesh_3 = Mesh(merge)
edge = Slider(17, range=0..47)
face = Slider(27, range=0..47)
mesh_topo_edge = MeshTopologyEdge(Mesh=mesh_3)  # -> ListOfEdges, FaceFaceStructure, EdgeFaceStructure
wbfacepolys = WeaverbirdsFacePolylines(Mesh=mesh_3)
explode = MeshExplode(Mesh=mesh_3, Interpolate=False)
format = Format(Format="{{*;{0}}}", Culture=127, Data0=face)
format_2 = Format(Format="{{*;{0}}}", Culture=127, Data0=edge)
pcen = PolygonCenter(Polyline=wbfacepolys)  # -> CenterV, CenterE, CenterA
eval = EvaluateLength(Curve=mesh_topo_edge.ListOfEdges, Length=0.5, Normalized=True)  # -> Point, Tangent, Parameter
split = SplitTree(Data=mesh_topo_edge.FaceFaceStructure, Masks=flatten(format))  # -> Positive, Negative
split_2 = SplitTree(Data=mesh_topo_edge.EdgeFaceStructure, Masks=flatten(format_2))  # -> Positive, Negative
points = PointList(Points=eval.Point, Tags=True, Lines=False, Size=12)
points_2 = PointList(Points=pcen.CenterV, Tags=True, Lines=False, Size=20)
ef = Panel(split_2.Positive)
item = ListItem(List=explode, Index=face, Wrap=True)

# ---- group: Adjacent faces to given face
item_2 = ListItem(List=explode, Index=split.Positive, Wrap=True)

# ----
item_3 = ListItem(List=mesh_topo_edge.ListOfEdges, Index=edge, Wrap=True)

# ---- group: Adjacent faces to given edge
item_4 = ListItem(List=explode, Index=split_2.Positive, Wrap=True)

# ----
ff = Panel(split.Positive)
pipe = Pipe(Curve=item_3, Radius=5, Caps=0)
