# Grasshopper definition TopologyMeshEdgeFilter.gh (Grasshopper 1.0.7)
# plug-ins: Sandbox Topology, Weaverbird

mesh = Mesh(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)
# "Select every edge that has N face neighbors."
# © 2025 by Tobias Schwinn
mesh_2 = Mesh(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)
merge = Merge(Data1=mesh_2, Data2=mesh)  # -> graft(Result)
# N = 1 => "naked" edges
# N = 2 => "clothed" edges
valency = Slider(2, range=1..3)
mesh_3 = Mesh(merge)
wbfacepolys = WeaverbirdsFacePolylines(Mesh=mesh_3)

mesh_topo_edge = MeshTopologyEdge(Mesh=mesh_3)  # -> ListOfEdges, FaceFaceStructure, EdgeFaceStructure
mesh_topo_edge_filter = MeshTopologyEdgeFilter(EdgeList=mesh_topo_edge.ListOfEdges, EdgeFaceStructure=mesh_topo_edge.EdgeFaceStructure, ValencyFilter=valency)  # -> ListOfEdgeIDs, ListOfEdges

pcen = PolygonCenter(Polyline=wbfacepolys)  # -> CenterV, CenterE, CenterA
eval = EvaluateLength(Curve=mesh_topo_edge.ListOfEdges, Length=0.5, Normalized=True)  # -> Point, Tangent, Parameter
item = ListItem(List=mesh_topo_edge.ListOfEdges, Index=mesh_topo_edge_filter.ListOfEdgeIDs, Wrap=True)
pipe = Pipe(Curve=mesh_topo_edge_filter.ListOfEdges, Radius=5, Caps=0)
points = PointList(Points=pcen.CenterV, Tags=True, Lines=False, Size=20)
points_2 = PointList(Points=eval.Point, Tags=True, Lines=False, Size=15)
I = Panel(mesh_topo_edge_filter.ListOfEdgeIDs)
