# Grasshopper definition TopologyMeshVertex.gh (Grasshopper 1.0.7)
# plug-ins: MeshEdit Components, Weaverbird, Sandbox Topology

mesh = Mesh(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)
# "List vertices that are connected to a given vertex."
# "List faces that share a given vertex."
# © 2025 by Tobias Schwinn
mesh_2 = Mesh(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)
merge = Merge(Data1=mesh_2, Data2=mesh)  # -> graft(Result)
mesh_3 = Mesh(merge)
vertex = Slider(10, range=0..47)
mesh_topo_vertex = MeshTopologyVertex(Mesh=mesh_3)  # -> ListOfMeshVertices, VertexVertexStructure, VertexFaceStructure
wbfacepolys = WeaverbirdsFacePolylines(Mesh=mesh_3)
explode = MeshExplode(Mesh=mesh_3, Interpolate=False)
format = Format(Format="{{*;{0}}}", Culture=127, Data0=vertex)
pcen = PolygonCenter(Polyline=wbfacepolys)  # -> CenterV, CenterE, CenterA
split = SplitTree(Data=mesh_topo_vertex.VertexVertexStructure, Masks=flatten(format))  # -> Positive, Negative
split_2 = SplitTree(Data=mesh_topo_vertex.VertexFaceStructure, Masks=flatten(format))  # -> Positive, Negative
points = PointList(Points=pcen.CenterV, Tags=True, Lines=False, Size=15)
points_2 = PointList(Points=mesh_topo_vertex.ListOfMeshVertices, Tags=True, Lines=False, Size=20)

# ---- group: Faces that do NOT share a given vertex
cull_i = CullIndex(List=explode, Indices=split_2.Positive, Wrap=True)

# ----
vf = Panel(split_2.Positive)
item = ListItem(List=mesh_topo_vertex.ListOfMeshVertices, Index=vertex, Wrap=True)

# ---- group: Vertices connected to given vertex
item_2 = ListItem(List=mesh_topo_vertex.ListOfMeshVertices, Index=split.Positive, Wrap=True)

# ---- group: Faces adjacent to given vertex
item_3 = ListItem(List=explode, Index=split_2.Positive, Wrap=True)

# ----
vv = Panel(split.Positive)
sph = Sphere(Base=item_2, Radius=10)
sph_2 = Sphere(Base=item, Radius=10)
preview = CustomPreview(Geometry=item_3, Material=ColourSwatch(SwatchColor=RGBA(147, 242, 92, 172)))
