# Grasshopper definition TopologyMeshVertexFilter.gh (Grasshopper 1.0.8)
# plug-ins: Sandbox Topology, Weaverbird

# ---- group: Multiple meshes in the same branch are treated as one network
# "Select every vertex that has N face neighbors."
# © 2025 by Tobias Schwinn
mesh = Mesh(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)
mesh_2 = Mesh(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)

# ----
mesh_3 = Mesh(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)
merge = Merge(Data1=[mesh, mesh_2], Data2=mesh_3)
mesh_4 = Mesh(merge)
valency = Slider(7, range=1..7)

mesh_topo_vertex = MeshTopologyVertex(Mesh=mesh_4)  # -> ListOfMeshVertices, VertexVertexStructure, VertexFaceStructure
mesh_topo_vertex_filter = MeshTopologyVertexFilter(
    VertexList=mesh_topo_vertex.ListOfMeshVertices,
    VertexFaceStructure=mesh_topo_vertex.VertexFaceStructure,
    ValencyFilter=valency)  # -> ListOfVertexIDs, ListOfVertices

wbfacepolys = WeaverbirdsFacePolylines(Mesh=mesh_4)
pshift = ShiftPaths(Data=wbfacepolys, Offset=-1)
pcen = PolygonCenter(Polyline=pshift)  # -> CenterV, CenterE, CenterA
item = ListItem(List=mesh_topo_vertex.ListOfMeshVertices, Index=mesh_topo_vertex_filter.ListOfVertexIDs, Wrap=True)
sph = Sphere(Base=mesh_topo_vertex_filter.ListOfVertices, Radius=25)
V = Panel(mesh_topo_vertex_filter.ListOfVertexIDs)
points = PointList(Points=pcen.CenterV, Tags=True, Lines=False, Size=20)
points_2 = PointList(Points=mesh_topo_vertex.ListOfMeshVertices, Tags=True, Lines=False, Size=15)
