# Grasshopper definition TopologyPolyEdge.gh (Grasshopper 1.0.7)
# plug-ins: LunchBox, Sandbox Topology

crv = Curve([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])
# © 2025 by Tobias Schwinn
crv_2 = Curve([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])
flatten = FlattenTree(Tree=crv_2, Path="{0}")
flatten_2 = FlattenTree(Tree=crv, Path="{1}")
merge = Merge(Data1=flatten, Data2=flatten_2)
edge = Slider(0, range=0..47)
crv_3 = Curve(merge)
tstat = TreeStatistics(Tree=crv_3)  # -> Paths, Length, Count
poly_topo_edge = PolygonTopologyEdge(ListOfPolylines=crv_3, Tolerance=Slider(0.001, range=0..1))  # -> ListOfEdges, LoopEdgeStructure, EdgeLoopStructure
dpath = DeconstructPath(Branch=tstat.Paths)
crossref = CrossReference(ListA=dpath, ListB=edge, CrossMode=1)  # -> ListA, ListB
pcen = PolygonCenter(Polyline=crv_3)  # -> CenterV, CenterE, CenterA
eval = EvaluateLength(Curve=poly_topo_edge.ListOfEdges, Length=0.5, Normalized=True)  # -> Point, Tangent, Parameter
merge_2 = Merge(Data1=crossref.ListA, Data2=crossref.ListB)
path = ConstructPath(Indices=merge_2)
points = PointList(Points=eval.Point, Tags=True, Lines=False, Size=15)
points_2 = PointList(Points=pcen.CenterV, Tags=True, Lines=False, Size=20)
branch = TreeBranch(Tree=poly_topo_edge.EdgeLoopStructure, Path=path, MaintainPaths=True)
el = Panel(branch)
item = ListItem(List=poly_topo_edge.ListOfEdges, Index=edge, Wrap=True)
item_2 = ListItem(List=crv_3, Index=branch, Wrap=True)
patch = PatchSurface(EdgeCurves=graft(item_2), U=5, V=5, Tolerance=0.001)
pipe = Pipe(Curve=item, Radius=10, Caps=0)
