# Grasshopper definition TopologyPolyEdgeFilter.gh (Grasshopper 1.0.7)
# plug-ins: Sandbox Topology

crv = Curve([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])
crv_2 = Curve([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])
flatten = FlattenTree(Tree=crv_2, Path="{0}")
flatten_2 = FlattenTree(Tree=crv, Path="{1}")
merge = Merge(Data1=flatten, Data2=flatten_2)
crv_3 = Curve([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])
tolerance = Slider(0.001, range=0.001..1)
valency = Slider(2, range=1..6)
crv_4 = Curve(merge)
pcen = PolygonCenter(Polyline=crv_4)  # -> CenterV, CenterE, CenterA

poly_topo_edge = PolygonTopologyEdge(ListOfPolylines=crv_4, Tolerance=tolerance)  # -> ListOfEdges, LoopEdgeStructure, EdgeLoopStructure
edge_list = EdgeToplogyFilter(EdgeList=poly_topo_edge.ListOfEdges, EdgeLoopStructure=poly_topo_edge.EdgeLoopStructure, ValencyFilter=valency)  # -> ListOfEdgeIDs, ListOfEdges

eval = EvaluateLength(Curve=poly_topo_edge.ListOfEdges, Length=0.5, Normalized=True)  # -> Point, Tangent, Parameter
points = PointList(Points=pcen.CenterV, Tags=True, Lines=False, Size=20)
pipe = Pipe(Curve=edge_list.ListOfEdges, Radius=5, Caps=0)
points_2 = PointList(Points=eval.Point, Tags=True, Lines=False, Size=15)
ids = Panel(edge_list.ListOfEdgeIDs)
