# Grasshopper definition TopologyPolyPoint.gh (Grasshopper 1.0.7)
# plug-ins: LunchBox, Sandbox Topology

crv = Curve([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])
# © 2025 by Tobias Schwinn
crv_2 = Curve([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])
flatten = FlattenTree(Tree=crv_2, Path="{0}")
flatten_2 = FlattenTree(Tree=crv, Path="{1}")
merge = Merge(Data1=flatten, Data2=flatten_2)
tolerance = Slider(0.001, range=0.001..1)
vertex = Slider(15, range=0..47)
crv_3 = Curve(merge)
tstat = TreeStatistics(Tree=crv_3)  # -> Paths, Length, Count
topology = PolygonTopology(ListOfPolylines=crv_3, Tolerance=tolerance)  # -> ListOfPoints, LoopPointStructure, PointLoopStructure
pcen = PolygonCenter(Polyline=crv_3)  # -> CenterV, CenterE, CenterA
dpath = DeconstructPath(Branch=tstat.Paths)
crossref = CrossReference(ListA=dpath, ListB=vertex, CrossMode=1)  # -> ListA, ListB
points = PointList(Points=pcen.CenterV, Tags=True, Lines=False, Size=20)
points_2 = PointList(Points=topology.ListOfPoints, Tags=True, Lines=False, Size=15)
merge_2 = Merge(Data1=crossref.ListA, Data2=crossref.ListB)
path = ConstructPath(Indices=merge_2)
branch = TreeBranch(Tree=topology.PointLoopStructure, Path=path, MaintainPaths=True)
item = ListItem(List=topology.ListOfPoints, Index=vertex, Wrap=True)  # -> Item, Item1
item_2 = ListItem(List=crv_3, Index=branch, Wrap=True)
patch = PatchSurface(EdgeCurves=graft(item_2), U=2, V=2, Tolerance=0.001)
pl = Panel(branch)
sph = Sphere(Base=item.Item, Radius=20)
