# Grasshopper definition TopologyPolyPointFilter.gh (Grasshopper 1.0.7)
# plug-ins: Sandbox Topology

crv = Curve([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])
crv_2 = Curve([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])
flatten = FlattenTree(Tree=crv_2, Path="{0}")
flatten_2 = FlattenTree(Tree=crv, Path="{1}")
crv_3 = Curve([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])
merge = Merge(Data1=flatten, Data2=flatten_2)
tolerance = Slider(0.001, range=0.001..1)
crv_4 = Curve(merge)
valency = Slider(3, range=1..6)
pcen = PolygonCenter(Polyline=crv_4)  # -> CenterV, CenterE

topology = PolygonTopology(ListOfPolylines=crv_4, Tolerance=tolerance)  # -> ListOfPoints, LoopPointStructure, PointLoopCollection
fpolyv = FilterPolygonVertices(PointList=topology.ListOfPoints, PointLoopStructure=topology.PointLoopCollection, ValencyFilter=valency)  # -> ListOfPointIDs, ListOfPoints

points = PointList(Points=pcen.CenterV, Tags=True, Lines=False, Size=20)
points_2 = PointList(Points=topology.ListOfPoints, Tags=True, Lines=False, Size=15)
I = Panel(fpolyv.ListOfPointIDs)
sph = Sphere(Base=fpolyv.ListOfPoints, Radius=20)
