# Grasshopper definition TopologyPolygon.gh (Grasshopper 1.0.7)
# plug-ins: Sandbox Topology

crv = Curve([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])
# © 2025 by Tobias Schwinn
crv_2 = Curve([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])
flatten = FlattenTree(Tree=crv_2, Path="{0}")
flatten_2 = FlattenTree(Tree=crv, Path="{1}")
merge = Merge(Data1=flatten, Data2=flatten_2)
poly_topo_point = PolygonTopologyPoint(ListOfPolylines=merge, Tolerance=0.001)  # -> ListOfPoints, LoopPointStructure, PointLoopStructure
poly_topo_edge = PolygonTopologyEdge(ListOfPolylines=merge, Tolerance=0.001)  # -> ListOfEdges, LoopEdgeStructure, EdgeLoopStructure
poly_topo_point_filter = PolygonTopologyPointFilter(PointList=poly_topo_point.ListOfPoints, PointLoopStructure=poly_topo_point.PointLoopStructure, ValencyFilter=1)  # -> ListOfPointIDs, ListOfPoints
poly_topo_edge_filter = PolygonTopologyEdgeFilter(
    EdgeList=poly_topo_edge.ListOfEdges,
    EdgeLoopStructure=poly_topo_edge.EdgeLoopStructure,
    ValencyFilter=Slider(2, range=0..10))  # -> ListOfEdgeIDs, ListOfEdges
linetopoidx = LineTopologyIndex(ListOfLines=poly_topo_edge_filter.ListOfEdges, Tolerance=0.001)  # -> ListOfPoints, LinePointStructure, PointPointStructure, PointLineStructure
pshift = ShiftPaths(Data=linetopoidx.PointLineStructure, Offset=-1)
panel = Panel(linetopoidx.PointLineStructure)
item = ListItem(List=poly_topo_edge_filter.ListOfEdges, Index=pshift, Wrap=True)
unflatten = UnflattenTree(Tree=item, Guide=linetopoidx.PointLineStructure)
line_filter = LineTopologyFilter(ListOfPoints=linetopoidx.ListOfPoints, PointLineStructure=unflatten, ValencyFilter=Slider(1, range=0..10))  # -> ListOfPoints, LineStructure
