# Grasshopper definition Validate_inputs.gh (Grasshopper 1.0.8)
# plug-ins: Sandbox Topology

mesh = Mesh()
mesh_2 = Mesh(Tree({1}: [], {2}: [null]))
crv = Curve()
line = Line()
brep = Brep()
brep_2 = Brep(Tree({1}: [], {2}: [null]))
crv_2 = Curve(Tree({1}: [], {2}: [null]))
line_2 = Line(Tree({1}: [], {2}: [Line((0, 0, 0), (0, 0, 0))]))
panel = Panel(line_2)
panel_2 = Panel(crv_2)
mesh_topo_vertex = MeshTopologyVertex(Meshes=mesh)  # -> ListOfMeshVertices, VertexVertexStructure, VertexFaceStructure
mesh_topo_edge = MeshTopologyEdge(Mesh=mesh)  # -> ListOfEdges, FaceFaceStructure, EdgeFaceStructure
poly_topo_edge = PolygonTopologyEdge(ListOfPolylines=crv_2, Tolerance=0.001)  # -> ListOfEdges, LoopEdgeStructure, EdgeLoopStructure
poly_topo_point = PolygonTopologyPoint(ListOfPolylines=crv_2, Tolerance=0.001)  # -> ListOfPoints, LoopPointStructure, PointLoopStructure
brep_topo_edge = BrepTopologyEdge(Breps=brep)  # -> ListOfEdgeCurves, FaceEdgeStructure, EdgeFaceStructure
brep_topo_vertex = BrepTopologyVertex(Brep=brep)  # -> ListOfVertices, FaceVertexStructure, VertexFaceStructure
linetopoidx = LineTopologyIndex(ListOfLines=line_2, Tolerance=0.001)  # -> ListOfPoints, ListOfLines, LinePointStructure, PointPointStructure, PointLineStructure
brep_topo_vertex_filter = BrepTopologyVertexFilter(VertexList=brep_topo_vertex.ListOfVertices, VertexFaceStructure=brep_topo_vertex.VertexFaceStructure, ValencyFilter=1)  # -> ListOfVertexIDs, ListOfVertices
brep_topo_edge_filter = BrepTopologyEdgeFilter(EdgeList=brep_topo_edge.ListOfEdgeCurves, EdgeFaceStructure=brep_topo_edge.EdgeFaceStructure, ValencyFilter=1)  # -> ListOfEdgeIDs, ListOfEdges
poly_topo_edge_filter = PolygonTopologyEdgeFilter(EdgeList=poly_topo_edge.ListOfEdges, EdgeLoopStructure=poly_topo_edge.EdgeLoopStructure, ValencyFilter=1)  # -> ListOfEdgeIDs, ListOfEdges
line_point_filter = LineTopologyPointFilter(ListOfPoints=linetopoidx.ListOfPoints, PointPointStructure=linetopoidx.PointPointStructure, ValencyFilter=1)  # -> ListOfPoints, ListOfPointIDs
line_edge_filter = LineTopologyEdgeFilter(ListOfLines=linetopoidx.ListOfLines, PointLineStructure=linetopoidx.PointLineStructure, ValencyFilter=1)  # -> ListOfLines, ListOfLineIDs
mesh_topo_vertex_filter = MeshTopologyVertexFilter(
    VertexList=mesh_topo_vertex.ListOfMeshVertices,
    VertexFaceStructure=mesh_topo_vertex.VertexFaceStructure,
    ValencyFilter=1)  # -> ListOfVertexIDs, ListOfVertices
mesh_topo_edge_filter = MeshTopologyEdgeFilter(EdgeList=mesh_topo_edge.ListOfEdges, EdgeFaceStructure=mesh_topo_edge.EdgeFaceStructure, ValencyFilter=1)  # -> ListOfEdgeIDs, ListOfEdges
poly_topo_point_filter = PolygonTopologyPointFilter(PointList=poly_topo_point.ListOfPoints, PointLoopStructure=poly_topo_point.PointLoopStructure, ValencyFilter=1)  # -> ListOfPointIDs, ListOfPoints
